# Grasshopper definition 05 Tick Tock Clock Stairs.ghx (Grasshopper 1.0.8)

crv = Curve(<curve referenced from the Rhino model>)
number_slider = Slider(3000, range=0..10000)
dom = ConstructDomain(DomainStart="700", DomainEnd="5000")
divlength = DivideLength(Curve=crv, Length=number_slider)  # -> Points, Tangents, Parameters
random = Random(Range=dom, Number="5", Seed=2)
division = Division(A=number_slider, B=2)
cir = Circle(Plane=divlength.Points, Radius=division)
divlength_2 = DivideLength(Curve=crv, Length=random)  # -> Points, Tangents, Parameters
crv_2 = Curve(<curve referenced from the Rhino model>)
curvepoint = PointOnCurve(crv_2, parameter=0)
cir_2 = Circle(Plane=curvepoint, Radius="500")
curvepoint_2 = PointOnCurve(crv_2, parameter=0.118)
crv_cp = CurveClosestPoint(Point=curvepoint_2, Curve=cir_2)  # -> Point, Parameter, Distance
curvepoint_3 = PointOnCurve(crv_2, parameter=0.281)
cir_3 = Circle(Plane=curvepoint_2, Radius=crv_cp.Distance)
crv_cp_2 = CurveClosestPoint(Point=curvepoint_3, Curve=cir_3)  # -> Point, Parameter, Distance
curvepoint_4 = PointOnCurve(crv_2, parameter=0.466)
cir_4 = Circle(Plane=curvepoint_3, Radius=crv_cp_2.Distance)
crv_cp_3 = CurveClosestPoint(Point=curvepoint_4, Curve=cir_4)  # -> Point, Parameter, Distance
curvepoint_5 = PointOnCurve(crv_2, parameter=0.605)
cir_5 = Circle(Plane=curvepoint_4, Radius=crv_cp_3.Distance)
crv_cp_4 = CurveClosestPoint(Point=curvepoint_5, Curve=cir_5)  # -> Point, Parameter, Distance
cir_6 = Circle(Plane=curvepoint_5, Radius=crv_cp_4.Distance)
graft = GraftTree(Tree=[cir_6, cir_4, cir_2], IncludeEmptyLists=True, IncludeNullItems=True)
graft_2 = GraftTree(Tree=[cir_5, cir_3], IncludeEmptyLists=True, IncludeNullItems=True)
offset = OffsetCurve(Curve=graft_2, Distance="-150", Corners=1)
offset_2 = OffsetCurve(Curve=graft_2, Distance="-75", Corners=1)
divlength_3 = DivideLength(Curve=graft_2, Length="100")  # -> Points, Tangents, Parameters
offset_3 = OffsetCurve(Curve=graft, Distance="75", Corners=1)
offset_4 = OffsetCurve(Curve=graft, Distance="150", Corners=1)
divlength_4 = DivideLength(Curve=graft, Length="100")  # -> Points, Tangents, Parameters
dispatch = Dispatch(List=divlength_3.Points, DispatchPattern=[True, False])  # -> ListA, ListB
crv_cp_5 = CurveClosestPoint(Point=divlength_3.Points, Curve=offset_2)  # -> Point, Parameter, Distance
crv_cp_6 = CurveClosestPoint(Point=divlength_3.Points, Curve=offset)  # -> Point, Parameter, Distance
crv_cp_7 = CurveClosestPoint(Point=divlength_4.Points, Curve=offset_3)  # -> Point, Parameter, Distance
crv_cp_8 = CurveClosestPoint(Point=divlength_4.Points, Curve=offset_4)  # -> Point, Parameter, Distance
addition = Addition(A=dispatch.ListA, B=dispatch.ListB)
panel = Panel("""0
1
2
1
0""")
dispatch_2 = Dispatch(List=crv_cp_8.Point, DispatchPattern=[True, False])  # -> ListA, ListB
division_2 = Division(A=addition, B="2")
addition_2 = Addition(A=dispatch_2.ListA, B=dispatch_2.ListB)
panel_2 = Panel("""2
1
0
1
2""")
division_3 = Division(A=addition_2, B="2")
weave = Weave(Pattern=panel, Stream0=divlength_4.Points, Stream1=crv_cp_7.Point, Stream2=division_3, NullGaps=False)
pline = PolyLine(Vertices=weave, Closed=invert(False))
weave_2 = Weave(Pattern=panel_2, Stream0=division_2, Stream1=crv_cp_5.Point, Stream2=crv_cp_6.Point, NullGaps=False)
pline_2 = PolyLine(Vertices=weave_2, Closed=invert(False))
