# Grasshopper definition 10 Dome experiment.ghx (Grasshopper 1.0.8)

pt = Point(<point referenced from the Rhino model>)
number_slider = Slider(4216, range=3000..5000)
number_slider_2 = Slider(10, range=5..20)
number_slider_3 = Slider(10, range=5..20)
xy = XYPlane(Origin=pt)
Z = UnitZ(Factor="-1")
move = Move(Geometry=xy, Motion=Z)  # -> Geometry, Transform
msphere = MeshSphere(Base=xy, Radius=number_slider, UCount=number_slider_2, VCount=number_slider_3)
msplit = MeshSplitPlane(Mesh=msphere, Plane=move.Geometry)  # -> Above, Below
number_slider_4 = Slider(50, range=50..100)
medges = MeshEdges(Mesh=msplit.Above)  # -> NakedEdges, InteriorEdges, NonManifoldEdges
pipe = Pipe(Curve=medges.InteriorEdges, Radius=number_slider_4, Caps=0)
addition = Addition(A=number_slider, B=number_slider_4)
sph = Sphere(Base=xy, Radius=addition)
msphere_2 = MeshSphere(Base=xy, Radius=addition, UCount=number_slider_2, VCount=number_slider_3)
cir = Circle(Plane=xy, Radius=addition)
msplit_2 = MeshSplitPlane(Mesh=msphere_2, Plane=move.Geometry)  # -> Above, Below
srfsplit = SurfaceSplit(Surface=sph, Curves=cir)
item = ListItem(List=srfsplit, Index="0", Wrap=True)
faceb = FaceBoundaries(Mesh=msphere_2)
demesh = DeconstructMesh(Mesh=msplit_2.Above)  # -> Vertices, Faces, Colours, Normals
panel = Panel(demesh.Faces)
item_2 = ListItem(List=demesh.Faces, Index="0", Wrap=True)
